% Simulink data dictionary Hepta_Integrated_SLDD.sldd

Reference = Simulink.ConfigSetRef()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
VLS_Standard_Configuration = Simulink.ConfigSet(StartTime="0", StopTime="10", FixedStep="0.02", Solver="FixedStepDiscrete", ProdHWDeviceType="NXP->Cortex-M0/M0+", SystemTargetFile="ert.tlc", TargetLang="C")  % AutoGeneratedSLSFconfig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
V_ActivePowerSupply = Simulink.Signal(StorageClass="GetSet", HeaderFile="Integrated_Hepta_wrapper.h", GetFunction="get_$N", SetFunction="set_$N", DataType="uint8", Min=0, Max=2, Unit="one")  % Power supply status(Main, Aux = 2)

V_AfsActStatus = Simulink.Signal(StorageClass="GetSet", HeaderFile="Integrated_Hepta_wrapper.h", GetFunction="get_$N", SetFunction="set_$N", DataType="boolean", Min=0, Max=1, Unit="one")  % Status of AFS
  % 0: Not active
  % 1: Active

V_AfsModeCanIn = Simulink.Signal(StorageClass="GetSet", HeaderFile="Integrated_Hepta_wrapper.h", GetFunction="get_$N", SetFunction="set_$N", DataType="uint8", Min=0, Max=10, Unit="one")  % AFS mode request

V_CanFail = Simulink.Signal(StorageClass="GetSet", HeaderFile="Integrated_Hepta_wrapper.h", GetFunction="get_$N", SetFunction="set_$N", DataType="boolean", Min=0, Max=1, Unit="one")  % This signal for status of CAN
  % 0: No CAN Fail
  % 1: CAN Fail

V_CmdDrlCanIn = Simulink.Signal(StorageClass="GetSet", HeaderFile="Integrated_Hepta_wrapper.h", GetFunction="get_$N", SetFunction="set_$N", DataType="boolean", Min=0, Max=1, Unit="one")  % DRL command
V_CmdPl1 = Simulink.Signal(StorageClass="GetSet", HeaderFile="Integrated_Hepta_wrapper.h", GetFunction="get_$N", SetFunction="set_$N", DataType="boolean", Min=0, Max=1, Unit="one")  % PL command
V_CmdPl2 = Simulink.Signal(StorageClass="GetSet", HeaderFile="Integrated_Hepta_wrapper.h", GetFunction="get_$N", SetFunction="set_$N", DataType="boolean", Min=0, Max=1, Unit="one")  % When V_ActivePowerSupply == 2 ----> V_CmdPl2 = 1

V_DayNightStatus = Simulink.Signal(StorageClass="GetSet", HeaderFile="Integrated_Hepta_wrapper.h", GetFunction="get_$N", SetFunction="set_$N", DataType="boolean", Min=0, Max=1, Unit="one")  % tells you if you are day or night
  % 0: Day
  % 1: Night

V_FtpRequest = Simulink.Signal(StorageClass="GetSet", HeaderFile="Integrated_Hepta_wrapper.h", GetFunction="get_$N", SetFunction="set_$N", DataType="boolean", Min=0, Max=1, Unit="one")  % FTP request
V_HeadlampSideCanIn = Simulink.Signal(StorageClass="GetSet", HeaderFile="Integrated_Hepta_wrapper.h", GetFunction="get_$N", SetFunction="set_$N", DataType="boolean", Min=0, Max=1, Unit="one")  % Headlamp side(0:left, 1:right)
V_HighBeamRequest = Simulink.Signal(StorageClass="GetSet", HeaderFile="Integrated_Hepta_wrapper.h", GetFunction="get_$N", SetFunction="set_$N", DataType="boolean", Min=0, Max=1, Unit="one")  % High beam request
V_LowBeamRequest = Simulink.Signal(StorageClass="GetSet", HeaderFile="Integrated_Hepta_wrapper.h", GetFunction="get_$N", SetFunction="set_$N", DataType="boolean", Min=0, Max=1, Unit="one")  % Low beam request
V_RevGearEng = Simulink.Signal(StorageClass="GetSet", HeaderFile="Integrated_Hepta_wrapper.h", GetFunction="get_$N", SetFunction="set_$N", DataType="boolean", Min=0, Max=1, Unit="one")  % Determine if reverse gear is engaged or not

V_RightClCanIn = Simulink.Signal(StorageClass="GetSet", HeaderFile="Integrated_Hepta_wrapper.h", GetFunction="get_$N", SetFunction="set_$N", DataType="boolean", Min=0, Max=1, Unit="one")  % 0: No Failure
  % 1: Failure

V_RightDblAngleCanIn = Simulink.Signal(StorageClass="GetSet", HeaderFile="Integrated_Hepta_wrapper.h", GetFunction="get_$N", SetFunction="set_$N", DataType="Angle_Type", Min=-15, Max=15, Unit="deg")  % Right DBL angle for adb slave
V_StWhAngle = Simulink.Signal(StorageClass="GetSet", HeaderFile="Integrated_Hepta_wrapper.h", GetFunction="get_$N", SetFunction="set_$N", DataType="Angle_Type", Min=-780, Max=780, Unit="deg")  % The steering wheel angle sent to preprocessing
V_TiCycle = Simulink.Signal(StorageClass="GetSet", HeaderFile="Integrated_Hepta_wrapper.h", GetFunction="get_$N", SetFunction="set_$N", DataType="boolean", Min=0, Max=1, Unit="one")  % Status to tell that the TI is in off cycle and not switched off
V_TiLeftRqst = Simulink.Signal(StorageClass="GetSet", HeaderFile="Integrated_Hepta_wrapper.h", GetFunction="get_$N", SetFunction="set_$N", DataType="boolean", Min=0, Max=1, Unit="one")  % TI request left
V_TiRightRqst = Simulink.Signal(StorageClass="GetSet", HeaderFile="Integrated_Hepta_wrapper.h", GetFunction="get_$N", SetFunction="set_$N", DataType="boolean", Min=0, Max=1, Unit="one")  % TI request right

V_VehSpeedFail = Simulink.Signal(StorageClass="GetSet", HeaderFile="Integrated_Hepta_wrapper.h", GetFunction="get_$N", SetFunction="set_$N", DataType="boolean", Min=0, Max=1, Unit="one")  % 0: No Failure
  % 1: Failure

V_VehicleSpeed = Simulink.Signal(StorageClass="GetSet", HeaderFile="Integrated_Hepta_wrapper.h", GetFunction="get_$N", SetFunction="set_$N", DataType="fixdt(0,16,0.01,0)", Min=0, Max=655.34, Unit="km/h")  % The vehicle speed sent through CAN
V_YawRate = Simulink.Signal(StorageClass="GetSet", HeaderFile="Integrated_Hepta_wrapper.h", GetFunction="get_$N", SetFunction="set_$N", DataType="Angle_Type", Min=-100, Max=100, Unit="deg/s")  % The vehicle yawrate sent through CAN
V_RequestedAnimation = Simulink.Signal(StorageClass="GetSet", HeaderFile="Integrated_Hepta_wrapper.h", GetFunction="get_$N", SetFunction="set_$N", DataType="uint8", Min=0, Max=2, Unit="one")  % Animation scenario request (0: no animation; x: animation scenario number)
V_TpsPwm = Simulink.Signal(StorageClass="GetSet", HeaderFile="Integrated_Hepta_wrapper.h", GetFunction="get_$N", SetFunction="set_$N", DataType="Pwm_Type", Min=0, Max=100, Unit="%", Dimensions="[1,C_NumOfLightingLeds + 3]")  % TPS Requested PWM
V_CurrentChannelPwm = Simulink.Signal(StorageClass="GetSet", HeaderFile="Integrated_Hepta_wrapper.h", GetFunction="get_$N", SetFunction="set_$N", DataType="Pwm_Type", Min=0, Max=100, Unit="%", Dimensions="[1,5]")  % Buck Requested PWM
V_CurrentChannelStatus = Simulink.Signal(StorageClass="GetSet", HeaderFile="Integrated_Hepta_wrapper.h", GetFunction="get_$N", SetFunction="set_$N", DataType="uint8", Min=0, Max=1, Unit="one", Dimensions="[1,5]")  % Buck Requested Status
V_RightClCanOut = Simulink.Signal(StorageClass="GetSet", HeaderFile="Integrated_Hepta_wrapper.h", GetFunction="get_$N", SetFunction="set_$N", DataType="boolean", Min=0, Max=1, Unit="one")  % Right Cl Activation
V_RightDblAngleCanOut = Simulink.Signal(StorageClass="GetSet", HeaderFile="Integrated_Hepta_wrapper.h", GetFunction="get_$N", SetFunction="set_$N", DataType="Angle_Type", Min=-15, Max=15, Unit="deg")  % Right DBL angle
V_AFS_modeCanOut = Simulink.Signal(StorageClass="GetSet", HeaderFile="Integrated_Hepta_wrapper.h", GetFunction="get_$N", SetFunction="set_$N", DataType="uint8", Min=0, Max=255, Unit="one")  % AFS mode request

C_AfsRampTimeMatrix = Simulink.Parameter([0 1 2 1 0 0 0 0 0 0 0
 0 1 2 1 0 0 0 0 0 0 0
 0 1 2 1 0 0 0 0 0 0 0
 0 1 2 1 0 0 0 0 0 0 0
 0 1 2 1 0 0 0 0 0 0 0
 0 1 2 1 0 0 0 0 0 0 0
 0 1 2 1 0 0 0 0 0 0 0
 0 1 2 1 0 0 0 0 0 0 0
 0 1 2 1 0 0 0 0 0 0 0
 0 1 2 1 0 0 0 0 0 0 0
 0 1 2 1 0 0 0 0 0 0 0], StorageClass="ImportedExternPointer", DataType="fixdt(0,16,0.005,0)", Min=0, Max=10, Unit="s", Dimensions="[C_NumOfLightingModes + 1,C_NumOfLightingModes + 1]")  % this parameter defines ramping time matrix for the distribution in case of chaning from mode to another one

C_CieCurveGammaToPwmY = Simulink.Parameter([0; 0.06; 0.11; 0.17; 0.22; 0.28; 0.33; 0.39; 0.44; 0.5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 100], StorageClass="ImportedExternPointer", DataType="fixdt(0,16,0.01,0)", Min=0, Max=100, Unit="%", Dimensions="[201,1]")  % Y points of the CIE curve that converts from Pwm To Gamma with Pwm [0:0.5:100].
C_CieCurvePwmToGammaY = Simulink.Parameter([0; 4.52; 8.99; 12.61; 15.49; 17.92; 20.04; 21.94; 23.67; 25.26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 100], StorageClass="ImportedExternPointer", DataType="fixdt(0,16,0.01,0)", Min=0, Max=100, Unit="%", Dimensions="[201,1]")  % Y points of the CIE curve that converts from Gamma To Pwm with Gamma [0:0.5:100].
C_ClLeftSideTable_Alpha1 = Simulink.Parameter([20; 35; 50], StorageClass="ImportedExternPointer", DataType="fixdt(1,16,0.1,0)", Min=0, Max=127, Unit="degree", Dimensions="[C_ClTableSize,1]")  % Angle table for Left Cl activation
C_ClLeftSideTable_Alpha2 = Simulink.Parameter([15; 20; 25], StorageClass="ImportedExternPointer", DataType="fixdt(1,16,0.1,0)", Min=0, Max=127, Unit="degree", Dimensions="[C_ClTableSize,1]")  % Angle table for Left Cl deactivation
C_ClRightSideTable_Alpha1 = Simulink.Parameter([20; 35; 50], StorageClass="ImportedExternPointer", DataType="fixdt(1,16,0.1,0)", Min=0, Max=127, Unit="degree", Dimensions="[C_ClTableSize,1]")  % Angle table for Right Cl activation
C_ClRightSideTable_Alpha2 = Simulink.Parameter([15; 20; 25], StorageClass="ImportedExternPointer", DataType="fixdt(1,16,0.1,0)", Min=0, Max=127, Unit="degree", Dimensions="[C_ClTableSize,1]")  % Angle table for Right Cl deactivation
C_ClSpeedCurve = Simulink.Parameter([0; 40; 70], StorageClass="ImportedExternPointer", DataType="fixdt(0,16,0.01,0)", Min=0, Max=511, Unit="km/hr", Dimensions="[C_ClTableSize,1]")  % Speed table for CL interpolation curve
C_DblInterDblAngValues = Simulink.Parameter([0 1.8 3.2 5.5 10.2 12 13.4 14.4 15], StorageClass="ImportedExternPointer", DataType="fixdt(0,16,0.1,0)", Min=0, Max=100, Unit="deg", Dimensions="[1,9]")  % C_DblInterDblAngValues
C_DblInterStwAngValues = Simulink.Parameter([0 15 24 34 51 58 65 73 90], StorageClass="ImportedExternPointer", DataType="fixdt(0,16,0.1,0)", Min=0, Max=100, Unit="deg", Dimensions="[1,9]")  % C_DblInterStwAngValues
C_DblLeftAngles = Simulink.Parameter(repmat(-10, 2, 10), StorageClass="ImportedExternPointer", DataType="fixdt(1,16,0.1,0)", Min=-15, Max=15, Unit="deg", Dimensions="[C_NumOfLightingModules,C_NumOfLightingModes]")  % this parameter defines the DBL left angles
C_DblRampTime = Simulink.Parameter(repmat(0, 2, 10), StorageClass="ImportedExternPointer", DataType="fixdt(0,16,0.005,0)", Min=0, Max=1, Unit="s", Dimensions="[C_NumOfLightingModules,C_NumOfLightingModes]")  % this parameter defnies the DBL ramping time
C_DblRightAngles = Simulink.Parameter(repmat(10, 2, 10), StorageClass="ImportedExternPointer", DataType="fixdt(1,16,0.1,0)", Min=-15, Max=15, Unit="deg", Dimensions="[C_NumOfLightingModules,C_NumOfLightingModes]")  % this parameter defines the DBL right angles
C_EndIndexOfEachLightingModule = Simulink.Parameter([0 1], StorageClass="ImportedExternPointer", DataType="uint8", Min=0, Max=255, Unit="one", Dimensions="[1,C_NumOfLightingModules]")  % this parameter defines the ending index for each module

C_IsDblActive = Simulink.Parameter([1 0 0 0 0 0 0 0 0 0
 1 0 1 0 0 0 0 0 0 0], StorageClass="ImportedExternPointer", DataType="boolean", Min=0, Max=1, Unit="one", Dimensions="[C_NumOfLightingModules,C_NumOfLightingModes]")  % this parameter is used to defines whether the DBL is active or not

C_LedCenterDist = Simulink.Parameter([0 100
 0 90
 0 80
 0 70
 0 60
 0 50
 0 40
 0 30
 88 88
 100 0], StorageClass="ImportedExternPointer", DataType="fixdt(0,16,0.01,0)", Min=0, Max=100, Unit="%", Dimensions="[C_NumOfLightingModes,C_NumOfLightingLeds]")  % PWM distribution of leds in case of DBL angle on center

C_LedCenterLimits = Simulink.Parameter([0 0], StorageClass="ImportedExternPointer", DataType="fixdt(1,16,0.1,0)", Min=-15, Max=15, Unit="deg", Dimensions="[1,C_NumOfLightingLeds]")  % this parameter defines the led center limits

C_LedLeftDist = Simulink.Parameter([0 100
 0 90
 0 80
 0 70
 0 60
 0 50
 0 40
 0 30
 88 88
 100 0], StorageClass="ImportedExternPointer", DataType="fixdt(0,16,0.01,0)", Min=0, Max=100, Unit="%", Dimensions="[C_NumOfLightingModes,C_NumOfLightingLeds]")  % PWM distribution of leds in case of DBL angle on left

C_LedRightDist = Simulink.Parameter([0 100
 0 90
 0 80
 0 70
 0 60
 0 50
 0 40
 0 30
 88 88
 100 0], StorageClass="ImportedExternPointer", DataType="fixdt(0,16,0.01,0)", Min=0, Max=100, Unit="%", Dimensions="[C_NumOfLightingModes,C_NumOfLightingLeds]")  % PWM distribution of leds in case of DBL angle on right

C_StartIndexOfEachLightingModule = Simulink.Parameter([0 1], StorageClass="ImportedExternPointer", DataType="uint8", Min=0, Max=255, Unit="one", Dimensions="[1,C_NumOfLightingModules]")  % this parameter defines the starting index  for each module
C_VspeedWfyaw = Simulink.Parameter([0 40 70], StorageClass="ImportedExternPointer", DataType="uint8", Min=0, Max=255, Unit="km/h", Dimensions="[1,3]")  % [Global] X values for the lookup table that manage the selection of the factor coefficient for curve radius combined calculation where the input is the vehicle speed
C_Wfyaw = Simulink.Parameter([0 1 1], StorageClass="ImportedExternPointer", DataType="fixdt(0,8,0.01,0)", Min=0, Max=1, Unit="one", Dimensions="[1,3]")  % [Global] Y values for the lookup table that manage the selection of the factor coefficient for curve radius combined calculation
C_AFS_SpeedThrAct = Simulink.Parameter(7, StorageClass="ImportedExternPointer", DataType="speed_type", Min=0, Max=511, Unit="one")  % Activation threshold for AFS function
C_AFS_Thr_Speed_HB_HS_OFF = Simulink.Parameter(90, StorageClass="ImportedExternPointer", DataType="speed_type", Min=0, Max=255, Unit="km/h")  % HB_HS deactivation threshold
C_AFS_Thr_Speed_HB_HS_ON = Simulink.Parameter(110, StorageClass="ImportedExternPointer", DataType="speed_type", Min=0, Max=255, Unit="km/h")  % HB_HS activation threshold
C_AccFiltCoeff = Simulink.Parameter(0.2, StorageClass="ImportedExternPointer", DataType="fixdt(0,8,0.01,0)", Min=0, Max=1, Unit="one")  % [Global] Low pass filter coefficient used for filtered vehicle longitudinal acceleration calculation
C_AngleScaleCoeff = Simulink.Parameter(1, StorageClass="ImportedExternPointer", DataType="fixdt(0,8,0.01,0)", Min=0, Max=2.55, Unit="one")  % [Global] coefficient that is multiplied by the filtered steering wheel angle to calculate the scaled filtered steering wheel angle which is used for the calculation of the dbl algorithm
C_CL_Ti_Speed_Hystresis = Simulink.Parameter(5, StorageClass="ImportedExternPointer", DataType="fixdt(0,16,0.1,0)", Min=0, Max=511, Unit="km/hr")  % Threshold hystresis speed to activate CL in case of turn indicator is on
C_CL_Ti_Speed_Threshold = Simulink.Parameter(40, StorageClass="ImportedExternPointer", DataType="fixdt(0,16,0.1,0)", Min=0, Max=511, Unit="km/hr")  % Threshold speed to activate CL in case of turn indicator is on
C_CSpeed0 = Simulink.Parameter(35, StorageClass="ImportedExternPointer", DataType="fixdt(0,16,0.1,0)", Min=0, Max=500, Unit="deg")  % C_CSpeed0

C_ClActAlgo = Simulink.Parameter(0, StorageClass="ImportedExternPointer", DataType="boolean", Min=0, Max=1, Unit="one")  % This parameter defines the priority between SBL & FBL
  % 0: means Activation by StWhAng is On
  % 1: means Activation by CurveRadius is On

C_ClManeuverPwm = Simulink.Parameter(60, StorageClass="ImportedExternPointer", DataType="fixdt(0,16,0.01,0)", Min=0, Max=100, Unit="%")  % CL PWM in Manuvering Mode
C_ClTableSize = Simulink.Parameter(3, StorageClass="ImportedExternPointer", DataType="int32", Min=1, Max=25, Unit="one")  % Num of Threshold in curve between speed and curve radius for SBL
C_ClTownPwm = Simulink.Parameter(30, StorageClass="ImportedExternPointer", DataType="fixdt(0,16,0.01,0)", Min=0, Max=100, Unit="%")  % CL PWM in Town Mode(LB width Enlargment)

C_Config = Simulink.Parameter(2, StorageClass="ImportedExternPointer", DataType="uint8", Min=1, Max=4, Unit="one")  % this parameter used to enable configuration (state machine diagrams)
  % if 1: activate configuration_1
  % 2: activate configuration_2
  % 3: activate configuration_3
  % 4: activate configuration_4

C_DblDeadZone = Simulink.Parameter(5, StorageClass="ImportedExternPointer", DataType="fixdt(0,16,0.1,0)", Min=0, Max=90, Unit="deg")  % C_DblDeadZone
C_DblRateLimit = Simulink.Parameter(5, StorageClass="ImportedExternPointer", DataType="fixdt(0,8,0.1,0)", Min=0, Max=15, Unit="deg")  % C_DblRateLimit
C_DblSlavePeriod = Simulink.Parameter(0.02, StorageClass="ImportedExternPointer", DataType="fixdt(0,8,0.005,0)", Min=0.005, Max=1.275, Unit="s")  % this parameter defines the sample time for dbl & afs slave
C_DblSpeed0 = Simulink.Parameter(15, StorageClass="ImportedExternPointer", DataType="fixdt(0,16,0.1,0)", Min=0, Max=500, Unit="deg")  % C_DblSpeed0
C_DirectionTransmissionFactor = Simulink.Parameter(15.7, StorageClass="ImportedExternPointer", DataType="fixdt(0,8,0.1,0)", Min=0, Max=25.5, Unit="one")  % [Global] used in preprocessing alorithm to define the ratio between steering wheel angle and the angle that the actual tire makes to calculate curve radius based on steering wheel angle
C_DrlRampTime = Simulink.Parameter(0, StorageClass="ImportedExternPointer", DataType="fixdt(0,16,0.005,0)", Min=0, Max=5.1, Unit="s")  % Ramp up time to turn on DRL
C_F_SpeedCountry2Town = Simulink.Parameter(25, StorageClass="ImportedExternPointer", DataType="speed_type", Min=0, Max=200, Unit="km/h")  % Speed threshold for transition from Country to Town Mode
C_F_SpeedPed2Town = Simulink.Parameter(15, StorageClass="ImportedExternPointer", DataType="speed_type", Min=0, Max=200, Unit="km/h")  % Speed threshold for transition from Pedestrian to Town Mode
C_F_SpeedTown2Country = Simulink.Parameter(30, StorageClass="ImportedExternPointer", DataType="speed_type", Min=0, Max=200, Unit="km/h")  % Speed threshold for transition from Town to Country Mode
C_F_SpeedTown2Ped = Simulink.Parameter(10, StorageClass="ImportedExternPointer", DataType="speed_type", Min=0, Max=200, Unit="km/h")  % Speed threshold for transition from Town to Pedestrian Mode
C_F_Time2WaitAFS = Simulink.Parameter(3, StorageClass="ImportedExternPointer", DataType="RampTime_Type", Min=0, Max=5, Unit="s")  % Time to wait to validate the AFS  modes transitions
C_FiltStWhAngCoeff = Simulink.Parameter(0.2, StorageClass="ImportedExternPointer", DataType="fixdt(0,8,0.01,0)", Min=0, Max=1, Unit="one")  % [Global] Low pass filter coefficient used for filtered steering wheel angle speed calculation
C_FiltStWhAngSpdCoeff = Simulink.Parameter(0.2, StorageClass="ImportedExternPointer", DataType="fixdt(0,8,0.01,0)", Min=0, Max=1, Unit="one")  % [Global] Low pass filter coefficient used for filtered steering wheel angle calculation
C_IsClOnTps = Simulink.Parameter(0, StorageClass="ImportedExternPointer", DataType="boolean", Min=0, Max=1, Unit="one")  % Determines if Ti is on Tps or not
C_IsDrlAutorizedInPower2 = Simulink.Parameter(0, StorageClass="ImportedExternPointer", DataType="boolean", Min=0, Max=1, Unit="one")  % If 0 then DRL is not authorized to work on auxilary supply 2
C_IsDrlPlOnTps = Simulink.Parameter(0, StorageClass="ImportedExternPointer", DataType="boolean", Min=0, Max=1, Unit="one")  % Determines if Drl/Pl is on Tps or not
C_IsPlAutorizedInPower2 = Simulink.Parameter(1, StorageClass="ImportedExternPointer", DataType="boolean", Min=0, Max=1, Unit="one")  % If 0 then PL is not authorized to work on auxilary supply 3
C_IsTiAutorizedInPower2 = Simulink.Parameter(0, StorageClass="ImportedExternPointer", DataType="boolean", Min=0, Max=1, Unit="one")  % If 0 then TI is not authorized to work on auxilary supply 4
C_IsTiOnTps = Simulink.Parameter(0, StorageClass="ImportedExternPointer", DataType="boolean", Min=0, Max=1, Unit="one")  % Determines if Ti is on Tps or not
C_LeftDblMaxAngle = Simulink.Parameter(2.5, StorageClass="ImportedExternPointer", DataType="fixdt(1,16,0.1,0)", Min=-25, Max=25, Unit="deg")  % C_LeftDblMaxAngle
C_LeftDblMinAngle = Simulink.Parameter(-15, StorageClass="ImportedExternPointer", DataType="fixdt(1,16,0.1,0)", Min=-25, Max=25, Unit="deg")  % C_LeftDblMinAngle

C_NumOfLightingLeds = Simulink.Parameter(2, StorageClass="ImportedExternPointer", DataType="int32", Min=0, Max=255, Unit="one")  % this parameter defines the total no. of leds, we put as default 13 led
  % until the system team defines the total no. of leds

C_NumOfLightingModes = Simulink.Parameter(10, StorageClass="ImportedExternPointer", DataType="int32", Min=0, Max=12, Unit="one")  % this parameter represents the number of modes
C_NumOfLightingModules = Simulink.Parameter(2, StorageClass="ImportedExternPointer", DataType="int32", Min=0, Max=20, Unit="one")  % in our case we have 2 modes for 1st lighting module(HB) and 8 modes for 2nd lighting Module(LB).
C_ParkingSpeedThrAct = Simulink.Parameter(7, StorageClass="ImportedExternPointer", DataType="speed_type", Min=0, Max=550, Unit="one")  % Parking speed Threshold for activation of parking mode
C_PlNominalPwm = Simulink.Parameter(10, StorageClass="ImportedExternPointer", DataType="uint8", Min=0, Max=100, Unit="%")  % Output PWM when PL is activated

C_PlOverDRL = Simulink.Parameter(1, StorageClass="ImportedExternPointer", DataType="boolean", Min=0, Max=1, Unit="one")  % this parameter to define the priority between PL &DRL
  % If 0: DRL has more priority than PL
  % 1: PL has more priority than DRL

C_RightDblMaxAngle = Simulink.Parameter(15, StorageClass="ImportedExternPointer", DataType="fixdt(1,16,0.1,0)", Min=-25, Max=25, Unit="deg")  % C_RightDblMaxAngle
C_RightDblMinAngle = Simulink.Parameter(-2.5, StorageClass="ImportedExternPointer", DataType="fixdt(1,16,0.1,0)", Min=-25, Max=25, Unit="deg")  % C_RightDblMinAngle
C_SpeedCountry2MW = Simulink.Parameter(90, StorageClass="ImportedExternPointer", DataType="speed_type", Min=0, Max=200, Unit="km/h")  % Speed threshold for transition from Country to Motorway Mode
C_SpeedMW2Country = Simulink.Parameter(70, StorageClass="ImportedExternPointer", DataType="speed_type", Min=0, Max=200, Unit="km/h")  % Speed threshold for transition from Motorway to Country Mode
C_TeAdbSlave = Simulink.Parameter(0.02, StorageClass="ImportedDefine", HeaderFile="Integrated_Hepta_calib.h", DataType="fixdt(0,8,0.005,0)", Min=0, Max=1.275, Unit="s")  % Sample time for low beam ramping
C_TeAfsMaster = Simulink.Parameter(0.02, StorageClass="ImportedDefine", HeaderFile="Integrated_Hepta_calib.h", DataType="fixdt(0,8,0.005,0)", Min=0, Max=1.275, Unit="s")  % Sample time for AFS_Master for waiting ticks between modes
C_Te_PPR = Simulink.Parameter(0.02, StorageClass="ImportedDefine", HeaderFile="Integrated_Hepta_calib.h", DataType="fixdt(0,8,0.01,0)", Min=0, Max=2.55, Unit="s")  % [Global] Periodicity of preprocessing runnable
C_TempoPark = Simulink.Parameter(1000, StorageClass="ImportedDefine", HeaderFile="Integrated_Hepta_calib.h", DataType="uint16", Min=0, Max=3000, Unit="one")  % Parking ticks that your vehicle will take and then the parking mode will be off

C_TickTIBlk = Simulink.Parameter(25, StorageClass="ImportedDefine", HeaderFile="Integrated_Hepta_calib.h", DataType="uint8", Min=1, Max=100, Unit="s")  % is used for timeout to indicate whether TI cycle expire or not
  % which used in CONF2, CONF3, and CONF4.

C_VehSpdCoeff = Simulink.Parameter(0.4, StorageClass="ImportedExternPointer", DataType="fixdt(0,8,0.01,0)", Min=0, Max=1, Unit="one")  % [Global] Low pass filter coefficient used for filtered speed calculation
C_WheelAxleDistance = Simulink.Parameter(2.56, StorageClass="ImportedExternPointer", DataType="fixdt(0,16,0.01,0)", Min=0, Max=8, Unit="m")  % [Global] used in preprocessing alorithm to define the distance between the center of two tires on the same vertical line to calculate curve radius based on steering wheel angle
C_AnimationOnLoop = Simulink.Parameter([0; 0], StorageClass="ImportedExternPointer", DataType="boolean", Min=0, Max=1, Unit="one", Dimensions="[C_NumOfScenarios,1]")  % [Global] Indicate whether this animation play on loop or not
C_AnimationPriority = Simulink.Parameter([0; 0], StorageClass="ImportedExternPointer", DataType="boolean", Min=0, Max=1, Unit="one", Dimensions="[C_NumOfScenarios,1]")  % [Global] AnimPrioOverHb
C_AnimationPeriod = Simulink.Parameter(0.05, StorageClass="ImportedDefine", HeaderFile="Integrated_Hepta_calib.h", DataType="fixdt(0,16,0.005,0)", Min=0, Max=1.275, Unit="s")  % [Global] Period of animation Runnable
C_DefaultValue = Simulink.Parameter(repmat(0, 5, 1), StorageClass="ImportedExternPointer", DataType="fixdt(0,8,0.5,0)", Min=0, Max=100, Unit="%", Dimensions="[C_NumOfLeds,1]")  % [Global] Output value when no animation is running
C_EndValues = Simulink.Parameter([20 0 30 50 70 100 20 0 30 50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 0], StorageClass="ImportedExternPointer", DataType="fixdt(0,8,0.5,0)", Min=0, Max=100, Unit="%", Dimensions="[1,C_NumOfSteps]")  % [Global] This parameter holds the end pwm % value of the ramp of each step for each led.
C_IndexOfStartStepForEachScenario = Simulink.Parameter([0 6 12 17 23; 29 35 41 46 52], StorageClass="ImportedExternPointer", DataType="uint16", Min=0, Max=65535, Unit="one", Dimensions="[C_NumOfScenarios,C_NumOfLeds]")  % [Global] This parameter holds the first step for each animation scenario
C_MaintainAnimationPwm = Simulink.Parameter([0; 1], StorageClass="ImportedExternPointer", DataType="boolean", Min=0, Max=1, Unit="one", Dimensions="[C_NumOfScenarios,1]")  % [Global] Indicate whether to maintain animation pwm when animation finishes or not
C_MaintainAnimationTime = Simulink.Parameter([0; 0.06], StorageClass="ImportedExternPointer", DataType="fixdt(0,16,0.01,0)", Min=0, Max=655.35, Unit="s", Dimensions="[C_NumOfScenarios,1]")  % [Global] The time to maintain animation pwm when it finishes, 0 means forever
C_NumOfStepsForEachScenario = Simulink.Parameter([6 6 5 6 6; 6 6 5 6 6], StorageClass="ImportedExternPointer", DataType="uint8", Min=0, Max=255, Unit="one", Dimensions="[C_NumOfScenarios,C_NumOfLeds]")  % [Global] This parameter holds the number of steps for each animation scenario.
C_StartValues = Simulink.Parameter([0 0 0 0 0; 100 100 70 100 100], StorageClass="ImportedExternPointer", DataType="fixdt(0,8,0.5,0)", Min=0, Max=100, Unit="%", Dimensions="[C_NumOfScenarios,C_NumOfLeds]")  % [Global] This parameter holds the start pwm % value of the first ramp for each led.
C_TRamp = Simulink.Parameter(repmat(0.05, 1, 58), StorageClass="ImportedExternPointer", DataType="fixdt(0,16,0.01,0)", Min=0, Max=655.35, Unit="s", Dimensions="[1,C_NumOfSteps]")  % [Global] This parameter holds the value of the ramp duration of each step seconds.
C_TStart = Simulink.Parameter([0.2 0.25 0.65 0.7 0.45 0.35 0.75 0.15 0.7 0.75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 0.25], StorageClass="ImportedExternPointer", DataType="fixdt(0,16,0.01,0)", Min=0, Max=655.35, Unit="s", Dimensions="[1,C_NumOfSteps]")  % [Global] This parameter holds the value of the delay before starting each step in seconds.
C_NumOfLeds = Simulink.Parameter(5, StorageClass="ImportedDefine", HeaderFile="Integrated_Hepta_calib.h", DataType="int32", Min=0, Max=255, Unit="one")  % [Global] This parameter must be set equal to the maximum number of animation segments.
C_NumOfScenarios = Simulink.Parameter(2, StorageClass="ImportedDefine", HeaderFile="Integrated_Hepta_calib.h", DataType="int32", Min=0, Max=255, Unit="one")  % [Global] This parameter must be set equal to the number of animation scenarios.
C_NumOfSteps = Simulink.Parameter(58, StorageClass="ImportedDefine", HeaderFile="Integrated_Hepta_calib.h", DataType="int32", Min=0, Max=32767, Unit="one")  % [Global] This parameter must be set equal to the total number of steps of all scenarios.
C_DblEnable = Simulink.Parameter(1, StorageClass="ImportedExternPointer", DataType="boolean", Min=0, Max=1, Unit="one")  % [Global] determine whether active DBL Master or not
C_ForceExternalAfsMode = Simulink.Parameter(0, StorageClass="ImportedExternPointer", DataType="boolean", Min=0, Max=1, Unit="one")  % [Global] determine whether Afs mode comes from External
C_LedStartIndexOfHb = Simulink.Parameter(0, StorageClass="ImportedExternPointer", DataType="uint8", Min=0, Max=255, Unit="one")  % this parameter defnies the start index of Hb module
C_LedStartIndexOfLb = Simulink.Parameter(1, StorageClass="ImportedExternPointer", DataType="uint8", Min=0, Max=255, Unit="one")  % this parameter defnies the start index of Lb module
C_LedStartIndexOfTi = Simulink.Parameter(2, StorageClass="ImportedExternPointer", DataType="uint8", Min=0, Max=255, Unit="one")  % this parameter defnies the start index of Ti module
C_LedStartIndexOfDrlPl = Simulink.Parameter(3, StorageClass="ImportedExternPointer", DataType="uint8", Min=0, Max=255, Unit="one")  % this parameter defnies the start index of DrlPl module
C_LedStartIndexOfCl = Simulink.Parameter(4, StorageClass="ImportedExternPointer", DataType="uint8", Min=0, Max=255, Unit="one")  % this parameter defnies the start index of Cl module
N_ANGLES_N360_360 = Simulink.Parameter([-360 -340 -320 -300 -280 -260 -240 -220 -200 -180 -160 -140 -120 -100 -80 -60 -40 -20 0 20 40 60 80 100 120 140 160 180 200 220 240 260 280 300 320 340 360], StorageClass="Const", DataType="Angle_Type", Min=-780, Max=780, Unit="one", Dimensions="[1,37]")
N_AccMax = Simulink.Parameter(10.16, StorageClass="Define", HeaderFile="Integrated_Hepta_calib.h", DataType="fixdt(1,32,0.0005,0)", Min=-10.24, Max=10.16, Unit="one")
N_AccMin = Simulink.Parameter(-10.24, StorageClass="Define", HeaderFile="Integrated_Hepta_calib.h", DataType="fixdt(1,32,0.0005,0)", Min=-10.24, Max=10.16, Unit="one")
N_ClMaxPwm = Simulink.Parameter(100, StorageClass="Define", HeaderFile="Integrated_Hepta_calib.h", DataType="fixdt(0,16,0.01,0)", Min=0, Max=100, Unit="%")  % N_LB_ON
N_ClOff = Simulink.Parameter(0, StorageClass="Define", HeaderFile="Integrated_Hepta_calib.h", DataType="boolean", Min=0, Max=1, Unit="one")  % Cornering light is Off
N_ClOn = Simulink.Parameter(1, StorageClass="Define", HeaderFile="Integrated_Hepta_calib.h", DataType="boolean", Min=0, Max=1, Unit="one")  % Cornering light is On
N_E_AdverseWeather = Simulink.Parameter(7, StorageClass="Define", HeaderFile="Integrated_Hepta_calib.h", DataType="uint8", Min=0, Max=12, Unit="one")
N_E_Country = Simulink.Parameter(1, StorageClass="Define", HeaderFile="Integrated_Hepta_calib.h", DataType="uint8", Min=0, Max=12, Unit="one")
N_E_Foggy = Simulink.Parameter(4, StorageClass="Define", HeaderFile="Integrated_Hepta_calib.h", DataType="uint8", Min=0, Max=12, Unit="one")
N_E_HBHighSpeed = Simulink.Parameter(10, StorageClass="Define", HeaderFile="Integrated_Hepta_calib.h", DataType="uint8", Min=0, Max=12, Unit="one")
N_E_HBLowSpeed = Simulink.Parameter(9, StorageClass="Define", HeaderFile="Integrated_Hepta_calib.h", DataType="uint8", Min=0, Max=12, Unit="one")
N_E_Motorway = Simulink.Parameter(3, StorageClass="Define", HeaderFile="Integrated_Hepta_calib.h", DataType="uint8", Min=0, Max=12, Unit="one")
N_E_NoFunction = Simulink.Parameter(0, StorageClass="Define", HeaderFile="Integrated_Hepta_calib.h", DataType="uint8", Min=0, Max=12, Unit="one")
N_E_Pedestrian = Simulink.Parameter(5, StorageClass="Define", HeaderFile="Integrated_Hepta_calib.h", DataType="uint8", Min=0, Max=12, Unit="one")  % Pedestrain Mode
N_E_TouristMode = Simulink.Parameter(8, StorageClass="Define", HeaderFile="Integrated_Hepta_calib.h", DataType="uint8", Min=0, Max=12, Unit="one")  % Tourist Mode
N_E_Town = Simulink.Parameter(2, StorageClass="Define", HeaderFile="Integrated_Hepta_calib.h", DataType="uint8", Min=0, Max=12, Unit="one")  % Town Mode
N_LIGHT_NIGHT = Simulink.Parameter(1, StorageClass="Const", DataType="boolean", Min=0, Max=1, Unit="one")  % define if it is day(=0) or night(=1)
N_ManeuverMode = Simulink.Parameter(6, StorageClass="Define", HeaderFile="Integrated_Hepta_calib.h", DataType="uint8", Min=0, Max=12, Unit="one")  % Parking Mode
N_MaxPwm = Simulink.Parameter(100, StorageClass="Define", HeaderFile="Integrated_Hepta_calib.h", DataType="uint8", Min=0, Max=255, Unit="one")  % Auxilary power supply value
N_PowerSupply2 = Simulink.Parameter(2, StorageClass="Define", HeaderFile="Integrated_Hepta_calib.h", DataType="uint8", Min=0, Max=255, Unit="one")  % Auxilary power supply value
N_Pwm_Off = Simulink.Parameter(0, StorageClass="Define", HeaderFile="Integrated_Hepta_calib.h", DataType="fixdt(0,16,0.01,0)", Min=0, Max=100, Unit="one")  % N_EngineRun_ON
N_SIN_REL_N360_360 = Simulink.Parameter([0 0.342 0.6428 0.866 0.9848 0.9848 0.866 0.6428 0.342 0 -0.342 -0.6428 -0.866 -0.9848 -0.9848 -0.866 -0.6428 -0.342 0 0.342 0.6428 0.866 0.9848 0.9848 0.866 0.6428 0.342 0 -0.342 -0.6428 -0.866 -0.9848 -0.9848 -0.866 -0.6428 -0.342 0], StorageClass="Const", DataType="fixdt(1,16,0.0001,0)", Min=-1, Max=1, Unit="one", Dimensions="[1,37]")
N_deg = Simulink.Parameter(180, StorageClass="Define", HeaderFile="Integrated_Hepta_calib.h", DataType="uint8", Min=0, Max=180, Unit="one")
N_max = Simulink.Parameter(3000, StorageClass="Define", HeaderFile="Integrated_Hepta_calib.h", DataType="int16", Min=-10000, Max=10000, Unit="one")
N_min = Simulink.Parameter(-3000, StorageClass="Define", HeaderFile="Integrated_Hepta_calib.h", DataType="int16", Min=-10000, Max=10000, Unit="one")
N_pi = Simulink.Parameter(3.14, StorageClass="Const", HeaderFile="Integrated_Hepta_calib.h", DataType="fixdt(0,16,0.01,0)", Min=0, Max=4, Unit="one")
N_spd_conv = Simulink.Parameter(3600, StorageClass="Const", HeaderFile="Integrated_Hepta_calib.h", DataType="uint16", Min=0, Max=65535, Unit="one")
Pwm_Type = Simulink.NumericType(DataTypeMode="Fixed-point: slope and bias scaling", SignednessBool=false, WordLength=16, FixedExponent=-7, SlopeAdjustmentFactor=1.28)
RampTime_Type = Simulink.NumericType(DataTypeMode="Fixed-point: slope and bias scaling", SignednessBool=false, WordLength=8, FixedExponent=-4, SlopeAdjustmentFactor=1.6)
Angle_Type = Simulink.NumericType(DataTypeMode="Fixed-point: slope and bias scaling", SignednessBool=true, WordLength=16, FixedExponent=-4, SlopeAdjustmentFactor=1.6)
tick_type = Simulink.NumericType(DataTypeMode="Fixed-point: slope and bias scaling", SignednessBool=false, WordLength=16, FixedExponent=-8, SlopeAdjustmentFactor=1.28)
dist_type = Simulink.NumericType(DataTypeMode="Fixed-point: slope and bias scaling", SignednessBool=false, WordLength=16, FixedExponent=0)
speed_type = Simulink.NumericType(DataTypeMode="Fixed-point: slope and bias scaling", SignednessBool=false, WordLength=16, FixedExponent=-7, SlopeAdjustmentFactor=1.28)