% Simulink data dictionary AFS_Master_Model.sldd

C_F_Time2WaitAFS = Simulink.Parameter(3, StorageClass="ImportedExternPointer", DataType="RampTime_Type", Min=0, Max=5, Unit="s")  % Inside: AfsMaster
speed_type = Simulink.NumericType(DataTypeMode="Fixed-point: slope and bias scaling", SignednessBool=false, WordLength=16, FixedExponent=-7, SlopeAdjustmentFactor=1.28)
RampTime_Type = Simulink.NumericType(DataTypeMode="Fixed-point: slope and bias scaling", SignednessBool=false, WordLength=8, FixedExponent=-4, SlopeAdjustmentFactor=1.6)
Reference = Simulink.ConfigSetRef()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
C_SpeedMW2Country = Simulink.Parameter(50, StorageClass="ImportedExternPointer", DataType="speed_type", Min=0, Max=200, Unit="km/h")  % Inside: AfsMaster
C_SpeedCountry2MW = Simulink.Parameter(70, StorageClass="ImportedExternPointer", DataType="speed_type", Min=0, Max=200, Unit="km/h")  % Inside: AfsMaster
C_F_SpeedTown2Ped = Simulink.Parameter(10, StorageClass="ImportedExternPointer", DataType="speed_type", Min=0, Max=200, Unit="km/h")  % Inside: AfsMaster
C_F_SpeedTown2Country = Simulink.Parameter(30, StorageClass="ImportedExternPointer", DataType="speed_type", Min=0, Max=200, Unit="km/h")  % Inside: AfsMaster
C_F_SpeedPed2Town = Simulink.Parameter(15, StorageClass="ImportedExternPointer", DataType="speed_type", Min=0, Max=200, Unit="km/h")  % Inside: AfsMaster
C_F_SpeedCountry2Town = Simulink.Parameter(25, StorageClass="ImportedExternPointer", DataType="speed_type", Min=0, Max=200, Unit="km/h")  % Inside: AfsMaster

V_ForceExternalAfsMode = Simulink.Signal(StorageClass="GetSet", HeaderFile="AFS_Master_wrapper.h", GetFunction="get_$N", SetFunction="set_$N", DataType="boolean", Min=0, Max=1, Unit="one")  % 0: Not Forcing
  % 1: Forcing AFS_Mode

C_AFS_Thr_Speed_HB_HS_ON = Simulink.Parameter(110, StorageClass="ImportedExternPointer", DataType="speed_type", Min=0, Max=255, Unit="km/h")  % Inside: AfsMaster
C_AFS_Thr_Speed_HB_HS_OFF = Simulink.Parameter(90, StorageClass="ImportedExternPointer", DataType="speed_type", Min=0, Max=255, Unit="km/h")  % Inside: AfsMaster
V_WetDetection = Simulink.Signal(StorageClass="GetSet", HeaderFile="AFS_Master_wrapper.h", GetFunction="get_$N", SetFunction="set_$N", DataType="boolean", Min=0, Max=1, Unit="one")
V_TouristModeActivated = Simulink.Signal(StorageClass="GetSet", HeaderFile="AFS_Master_wrapper.h", GetFunction="get_$N", SetFunction="set_$N", DataType="boolean", Min=0, Max=1, Unit="one")  % Activate the Tourrist Mode (Change the Kink side)
V_Foggy = Simulink.Signal(StorageClass="GetSet", HeaderFile="AFS_Master_wrapper.h", GetFunction="get_$N", SetFunction="set_$N", DataType="boolean", Min=0, Max=1, Unit="one")  % Activate the Tourrist Mode (Change the Kink side)
V_AfsMode = Simulink.Signal(StorageClass="GetSet", HeaderFile="AFS_Master_wrapper.h", GetFunction="get_$N", SetFunction="set_$N", DataType="uint8", Min=0, Max=12, Unit="one")
C_TeAfsMaster = Simulink.Parameter(0.02, StorageClass="ImportedExternPointer", DataType="fixdt(0,8,0.005,0)", Min=0, Max=1.275, Unit="s")  % Sample time for AFS_Master for waiting ticks between modes
VLS_Standard_Configuration = Simulink.ConfigSet(StartTime="0", StopTime="10", FixedStep="0.02", Solver="FixedStepDiscrete", ProdHWDeviceType="NXP->Cortex-M0/M0+", SystemTargetFile="ert.tlc", TargetLang="C")  % AutoGeneratedSLSFconfig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

V_Veh_speed_Fail = Simulink.Signal(StorageClass="GetSet", HeaderFile="AFS_Master_wrapper.h", GetFunction="get_$N", SetFunction="set_$N", DataType="boolean", Min=0, Max=1, Unit="one")  % 0: No Failure
  % 1: Failure

V_RevGearEng = Simulink.Signal(StorageClass="GetSet", HeaderFile="AFS_Master_wrapper.h", GetFunction="get_$N", SetFunction="set_$N", DataType="boolean", Min=0, Max=1, Unit="one")  % Determine if reverse gear is engaged or not

V_Mod_RightFail = Simulink.Signal(StorageClass="GetSet", HeaderFile="AFS_Master_wrapper.h", GetFunction="get_$N", SetFunction="set_$N", DataType="boolean", Min=0, Max=1, Unit="one")  % Mode right status
  % 0: No Failure
  % 1: Failure

V_Mod_LeftFail = Simulink.Signal(StorageClass="GetSet", HeaderFile="AFS_Master_wrapper.h", GetFunction="get_$N", SetFunction="set_$N", DataType="boolean", Min=0, Max=1, Unit="one")  % Mode Left status
  % 0: No Failure
  % 1: Failure

V_LbStatus = Simulink.Signal(StorageClass="GetSet", HeaderFile="AFS_Master_wrapper.h", GetFunction="get_$N", SetFunction="set_$N", DataType="boolean", Min=0, Max=1, Unit="one")  % Low beam request

V_HBNoADBRequest = Simulink.Signal(StorageClass="GetSet", HeaderFile="AFS_Master_wrapper.h", GetFunction="get_$N", SetFunction="set_$N", DataType="boolean", Min=0, Max=1, Unit="one")  % tell you if High beam active manually without ADB
  % 0: Not active
  % 1: Active

V_FiltVehSpeed = Simulink.Signal(StorageClass="GetSet", HeaderFile="AFS_Master_wrapper.h", GetFunction="get_$N", SetFunction="set_$N", DataType="fixdt(0,16,0.01,0)", Min=0, Max=655.34, Unit="km/h")  % Filtered vehicle speed
V_ExternalAfsMode = Simulink.Signal(StorageClass="GetSet", HeaderFile="AFS_Master_wrapper.h", GetFunction="get_$N", SetFunction="set_$N", DataType="uint8", Min=0, Max=12, Unit="one")  % External AFS_Mode

V_DayNightStatus = Simulink.Signal(StorageClass="GetSet", HeaderFile="AFS_Master_wrapper.h", GetFunction="get_$N", SetFunction="set_$N", DataType="boolean", Min=0, Max=1, Unit="one")  % tells you if you are day or night
  % 0: Day
  % 1: Night

V_CAN_Fail = Simulink.Signal(StorageClass="GetSet", HeaderFile="AFS_Master_wrapper.h", GetFunction="get_$N", SetFunction="set_$N", DataType="boolean", Min=0, Max=1, Unit="one")  % This signal for status of CAN
  % 0: No CAN Fail
  % 1: CAN Fail

V_AFS_Fail = Simulink.Signal(StorageClass="GetSet", HeaderFile="AFS_Master_wrapper.h", GetFunction="get_$N", SetFunction="set_$N", DataType="boolean", Min=0, Max=1, Unit="one")  % AFS Failure Status
  % 0: No Failure
  % 1: Failure

V_ActivateADBFeatures = Simulink.Signal(StorageClass="GetSet", HeaderFile="AFS_Master_wrapper.h", GetFunction="get_$N", SetFunction="set_$N", DataType="boolean", Min=0, Max=1, Unit="one")  % Low beam request
N_LIGHT_NIGHT = Simulink.Parameter(1, StorageClass="Const", DataType="boolean", Min=0, Max=1, Unit="one")  % define if it is day(=0) or night(=1)
C_TempoPark = Simulink.Parameter(1000, StorageClass="ImportedExternPointer", DataType="uint16", Min=0, Max=3000, Unit="one")  % Parking ticks that your vehicle will take and then the parking mode will be off
C_ParkingSpeedThrAct = Simulink.Parameter(7, StorageClass="ImportedExternPointer", DataType="speed_type", Min=0, Max=550, Unit="one")  % Parking speed Threshold for activation of parking mode
C_AFS_SpeedThrAct = Simulink.Parameter(7, StorageClass="ImportedExternPointer", DataType="speed_type", Min=0, Max=511, Unit="one")  % Inside: Preprocessing

V_AFS_ActStatus = Simulink.Signal(StorageClass="GetSet", HeaderFile="AFS_Master_wrapper.h", GetFunction="get_$N", SetFunction="set_$N", DataType="boolean", Min=0, Max=1, Unit="one")  % Status of AFS
  % 0: Not active
  % 1: Active

N_E_AdverseWeather = Simulink.Parameter(7, StorageClass="Define", DataType="uint8", Min=0, Max=12, Unit="one")
N_E_Country = Simulink.Parameter(1, StorageClass="Define", DataType="uint8", Min=0, Max=12, Unit="one")
N_E_Foggy = Simulink.Parameter(4, StorageClass="Define", DataType="uint8", Min=0, Max=12, Unit="one")
N_E_HBHighSpeed = Simulink.Parameter(10, StorageClass="Define", DataType="uint8", Min=0, Max=12, Unit="one")
N_E_HBLowSpeed = Simulink.Parameter(9, StorageClass="Define", DataType="uint8", Min=0, Max=12, Unit="one")
N_E_Motorway = Simulink.Parameter(3, StorageClass="Define", DataType="uint8", Min=0, Max=12, Unit="one")
N_E_Pedestrian = Simulink.Parameter(5, StorageClass="Define", DataType="uint8", Min=0, Max=12, Unit="one")  % Pedestrain Mode
N_E_NoFunction = Simulink.Parameter(0, StorageClass="Define", DataType="uint8", Min=0, Max=12, Unit="one")
N_E_Town = Simulink.Parameter(2, StorageClass="Define", DataType="uint8", Min=0, Max=12, Unit="one")  % Town Mode
N_ManeuverMode = Simulink.Parameter(6, StorageClass="Define", DataType="uint8", Min=0, Max=12, Unit="one")  % Parking Mode
N_E_TouristMode = Simulink.Parameter(8, StorageClass="Define", DataType="uint8", Min=0, Max=12, Unit="one")  % Tourist Mode