% Simulink data dictionary AFS_Master_Model_Test.sldd

speed_type = Simulink.NumericType(DataTypeMode="Fixed-point: slope and bias scaling", SignednessBool=false, WordLength=16, FixedExponent=-7, SlopeAdjustmentFactor=1.28)
RampTime_Type = Simulink.NumericType(DataTypeMode="Fixed-point: slope and bias scaling", SignednessBool=false, WordLength=8, FixedExponent=-4, SlopeAdjustmentFactor=1.6)
Reference = Simulink.ConfigSetRef()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
V_RevGearEng = Simulink.Signal(DataType="boolean", Min=0, Max=1, Unit="one")  % Determine if reverse gear is engaged or not
V_NoAfsFunction = Simulink.Signal(DataType="boolean", Min=0, Max=1)
V_LbStatus = Simulink.Signal(DataType="boolean", Min=0, Max=1, Unit="one")  % Low beam request
V_HBStatus = Simulink.Signal(DataType="boolean", Min=0, Max=1, Unit="one")  % Low beam request
V_HbModeFromMaster = Simulink.Signal(DataType="uint8")
V_ForceExternalAfsMode = Simulink.Signal(DataType="uint8")
V_FiltVehSpeed = Simulink.Signal(DataType="fixdt(0,16,0.01,0)", Min=0, Max=655.34, Unit="km/h")  % Filtered vehicle speed
V_ExternalAfsMode = Simulink.Signal(DataType="uint8")
V_B_WetDetection = Simulink.Signal(DataType="boolean", Min=0, Max=1)
V_B_TouristModeActivated = Simulink.Signal(DataType="boolean")  % Activate the Tourrist Mode (Change the Kink side)
V_B_HB_HS_Activation_CAN_Request = Simulink.Signal(DataType="boolean", Min=0, Max=1)
V_B_Foggy = Simulink.Signal(DataType="boolean")  % Activate the Tourrist Mode (Change the Kink side)
V_AfsModeFromMaster = Simulink.Signal(DataType="uint8")
V_ActivateADBFeatures = Simulink.Signal(DataType="boolean", Min=0, Max=1, Unit="one")  % Low beam request
N_ManeuverMode = Simulink.Parameter(2, DataType="uint8", Min=0, Max=2)  % N_ManeuverMode
N_E_Town = Simulink.Parameter(2, DataType="uint8")
N_E_TouristMode = Simulink.Parameter(8, DataType="uint8")
N_E_Pedestrian = Simulink.Parameter(5, DataType="uint8")
N_E_NoFunction = Simulink.Parameter(0, DataType="uint8")
N_E_Motorway = Simulink.Parameter(3, DataType="uint8")
N_E_HbTypeHb_Ls = Simulink.Parameter(1, DataType="uint8")
N_E_HbTypeHb_Hs = Simulink.Parameter(2, DataType="uint8")
N_E_HBLowSpeed = Simulink.Parameter(9, DataType="uint8")
N_E_HBHighSpeed = Simulink.Parameter(10, DataType="uint8")
N_E_Foggy = Simulink.Parameter(4, DataType="uint8")
N_E_Country = Simulink.Parameter(1, DataType="uint8")
N_E_AdverseWeather = Simulink.Parameter(7, DataType="uint8")
C_TempoPark = Simulink.Parameter(1000, DataType="uint16", Min=0, Max=3000)  % Inside: AFS_Master

C_TeAdbSlave = Simulink.Parameter(0.02, DataType="fixdt(0,8,0.005,0)", Min=0, Max=1.275, Unit="s")  % Sample time for low beam ramping
  % Inside: ADB_Slave

C_F_Time2WaitAFS = Simulink.Parameter(3, DataType="RampTime_Type", Min=0, Max=5, Unit="s")  % Inside: AfsMaster
C_F_SpeedTown2Ped = Simulink.Parameter(10, DataType="speed_type", Min=0, Max=200, Unit="s")  % Inside: AfsMaster
C_F_SpeedTown2Country = Simulink.Parameter(30, DataType="speed_type", Min=0, Max=200, Unit="s")  % Inside: AfsMaster
C_F_SpeedPed2Town = Simulink.Parameter(15, DataType="speed_type", Min=0, Max=200, Unit="s")  % Inside: AfsMaster
C_F_SpeedCountry2Town = Simulink.Parameter(25, DataType="speed_type", Min=0, Max=200, Unit="s")  % Inside: AfsMaster

C_B_LB_HW_ActivationEnable = Simulink.Parameter(1, DataType="boolean", Min=0, Max=1, Unit="one")  % Animation Scenario mapping
  % Inside: AfsMaster

C_B_HB_HW_ActivationType = Simulink.Parameter(0, DataType="uint8", Min=0, Max=1, Unit="one")  % Animation Scenario mapping
  % Inside: AfsMAster

C_B_HB_HW_ActivationEnable = Simulink.Parameter(1, DataType="boolean", Min=0, Max=1, Unit="one")  % Animation Scenario mapping
  % Inside: AfsMaster

C_AFS_Thr_Speed_HB_HS_ON = Simulink.Parameter(110, DataType="uint8", Min=0, Max=255, Unit="kmh")  % Inside: AfsMaster
C_AFS_Thr_Speed_HB_HS_OFF = Simulink.Parameter(90, DataType="uint8", Min=0, Max=255, Unit="kmh")  % Inside: AfsMaster
C_AFS_SpeedThrAct = Simulink.Parameter(7, DataType="speed_type", Min=0, Max=511)  % Inside: Preprocessing
VLS_Standard_Configuration = Simulink.ConfigSet(StartTime="0", StopTime="10", FixedStep="0.02", Solver="FixedStepDiscrete", ProdHWDeviceType="NXP->Cortex-M0/M0+", SystemTargetFile="ert.tlc", TargetLang="C")  % AutoGeneratedSLSFconfig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