% Simulink data dictionary StdAnimation_TestingDD.sldd

C_CieCurvePwmToGammaY = Simulink.Parameter([0; 4.52; 8.99; 12.61; 15.49; 17.92; 20.04; 21.94; 23.67; 25.26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 100], StorageClass="Const", HeaderFile="ANIM_cfg.h", DefinitionFile="ANIM_cfg.c", DataType="fixdt(0,16,0.01,0)", Min=0, Max=100, Unit="one", Dimensions="[201,1]")  % Y points of the CIE curve that converts from Pwm To Gamma with Pwm [0:0.5:100].
C_CieCurveGammaToPwmY = Simulink.Parameter([0; 0.06; 0.11; 0.17; 0.22; 0.28; 0.33; 0.39; 0.44; 0.5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 100], StorageClass="Const", HeaderFile="ANIM_cfg.h", DefinitionFile="ANIM_cfg.c", DataType="fixdt(0,16,0.01,0)", Min=0, Max=100, Unit="%", Dimensions="[201,1]")  % Y points of the CIE curve that converts from Gamma To Pwm with Gamma [0:0.5:100].
C_AnimationPeriod = Simulink.Parameter(0.02, StorageClass="Const", HeaderFile="ANIM_cfg.h", DefinitionFile="ANIM_cfg.c", DataType="fixdt(0,16,0.005,0)", Min=0, Max=1.275, Unit="s")  % Period of animation Runnable.

V_RequestedScenarioNum = Simulink.Signal(StorageClass="GetSet", HeaderFile="ANIM_int.h", GetFunction="get_$N", SetFunction="set_$N", DataType="uint8", Min=0, Max=255, Unit="one")  % This input signal is the requested animation scenario to run.
  % NOTE:  '0' means stop animation.

V_AnimationFinished = Simulink.Signal(StorageClass="GetSet", HeaderFile="ANIM_int.h", GetFunction="get_$N", SetFunction="set_$N", DataType="boolean", Min=0, Max=1, Unit="one")  % This signal is whether an animation is finished or not.
V_FinishedAnimationNumber = Simulink.Signal(StorageClass="GetSet", HeaderFile="ANIM_int.h", GetFunction="get_$N", SetFunction="set_$N", DataType="uint8", Min=0, Max=255, Unit="one")  % This signal is the animation number which has just concluded execution.
V_RunningAnimationNumber = Simulink.Signal(StorageClass="GetSet", HeaderFile="ANIM_int.h", GetFunction="get_$N", SetFunction="set_$N", DataType="uint8", Min=0, Max=255, Unit="one")  % This signal is the current running animation scenarion number.
V_AnimationPwm = Simulink.Signal(StorageClass="GetSet", HeaderFile="ANIM_int.h", GetFunction="get_$N", SetFunction="set_$N", DataType="fixdt(0,16,0.01,0)", Min=0, Max=100, Unit="%", Dimensions="C_NumOfLeds")  % This signal is the number of animation PWM outputs.
C_TStart = Simulink.Parameter([0; 0.4; 0; 0.4; 0; 0.4; 0; 0.4; 0; 0.4; 0; 0.4; 0; 0.4; 0; 0.4; 0; 0.4; 0; 0.4; 0; 0.4; 0; 0.4; 0; 0.4; 0; 0.4; 0; 0.4; 0; 0.4], StorageClass="ImportedExternPointer", DataType="fixdt(0,16,0.01,0)", Min=0, Max=655.35, Unit="s", Dimensions="[C_NumOfSteps,1]")  % This parameter holds the value of the delay before starting each sequence for each led for each step in seconds.
C_TRamp = Simulink.Parameter([0.2; 0.4; 0.2; 0.4; 0.2; 0.4; 0.2; 0.4; 0.2; 0.4; 0.2; 0.4; 0.2; 0.4; 0.2; 0.4; 0.2; 0.4; 0.2; 0.4; 0.2; 0.4; 0.2; 0.4; 0.2; 0.4; 0.2; 0.4; 0.2; 0.4; 0.2; 0.4], StorageClass="ImportedExternPointer", DataType="fixdt(0,16,0.01,0)", Min=0, Max=655.35, Unit="s", Dimensions="[C_NumOfSteps,1]")  % This parameter holds the value of the ramp duration of each sequence for each led for each step in seconds.
C_NumOfSteps = Simulink.Parameter(32, StorageClass="Define", HeaderFile="ANIM_cfg.h", DataType="int32", Min=0, Max=255, Unit="one")  % This parameter must be set equal to the total number of steps of all scenarios.
C_IndexOfStartStepForEachScenario = Simulink.Parameter([0 2 4; 8 10 12; 16 18 20; 24 26 28], StorageClass="ImportedExternPointer", DataType="uint8", Min=0, Max=255, Unit="one", Dimensions="[C_NumOfScenarios,C_NumOfLeds]")  % This parameter holds the first step for each animation scenario.
C_NumOfStepsForEachScenario = Simulink.Parameter([2 2 4; 2 2 4; 2 2 4; 2 2 4], StorageClass="ImportedExternPointer", DataType="uint8", Min=0, Max=255, Unit="one", Dimensions="[C_NumOfScenarios,C_NumOfLeds]")  % This parameter holds the number of steps for each animation scenario for each segment (LED).
C_EndValues = Simulink.Parameter([10; 20; 20; 10; 10; 30; 20; 0; 10; 20; 20; 10; 10; 30; 20; 0; 10; 20; 20; 10; 10; 30; 20; 0; 10; 20; 20; 10; 10; 30; 20; 0], StorageClass="ImportedExternPointer", DataType="fixdt(0,8,0.5,0)", Min=0, Max=100, Unit="%", Dimensions="[C_NumOfSteps,1]")  % This parameter holds the end % value of the ramp of each step for each led.
C_StartValues = Simulink.Parameter([0 50 0; 0 50 0; 0 50 0; 0 50 0], StorageClass="ImportedExternPointer", DataType="fixdt(0,8,0.5,0)", Min=0, Max=100, Unit="%", Dimensions="[C_NumOfScenarios,C_NumOfLeds]")  % This parameter holds the start % value of the first ramp for each led.
C_NumOfScenarios = Simulink.Parameter(4, StorageClass="Define", HeaderFile="ANIM_cfg.h", DataType="int32", Min=0, Max=255, Unit="one")  % This parameter must be set equal to the number of animation scenarios.
C_NumOfLeds = Simulink.Parameter(3, StorageClass="Define", HeaderFile="ANIM_cfg.h", DataType="int32", Min=0, Max=255, Unit="one")  % This parameter must be set equal to the maximum number of animation segments.
C_AnimationOnLoop = Simulink.Parameter([0; 0; 0; 1], StorageClass="ImportedExternPointer", DataType="boolean", Min=0, Max=1, Unit="one", Dimensions="[C_NumOfScenarios,1]")
C_MaintainAnimationTime = Simulink.Parameter([0; 1; 0; 0], StorageClass="ImportedExternPointer", DataType="fixdt(0,16,0.01,0)", Min=0, Max=655.35, Unit="s", Dimensions="[C_NumOfScenarios,1]")
C_MaintainAnimationPwm = Simulink.Parameter([0; 1; 1; 0], StorageClass="ImportedExternPointer", DataType="boolean", Min=0, Max=1, Unit="one", Dimensions="[C_NumOfScenarios,1]")
C_DefaultValue = Simulink.Parameter([100; 100; 100], StorageClass="ImportedExternPointer", DataType="fixdt(0,8,0.5,0)", Min=0, Max=100, Unit="%", Dimensions="[C_NumOfLeds,1]")  % Output value when no animation is running.
VLS_SIL_Configuration = Simulink.ConfigSet(StartTime="0", StopTime="15", FixedStep="0.02", Solver="FixedStepDiscrete", ProdHWDeviceType="NXP->Cortex-M0/M0+", SystemTargetFile="ert.tlc", TargetLang="C")  % AutoGeneratedSLSFconfig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
Reference = Simulink.ConfigSetRef()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