% Simulink data dictionary CL_MasterDD_CurveRad_Active.sldd

VLS_Standard_Configuration = Simulink.ConfigSet(StartTime="0", StopTime="10", FixedStep="0.02", Solver="FixedStepDiscrete", ProdHWDeviceType="NXP->Cortex-M0/M0+", SystemTargetFile="ert.tlc", TargetLang="C")  % AutoGeneratedSLSFconfig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
C_CL_Ti_Speed_Hystresis = Simulink.Parameter(5, StorageClass="ImportedExternPointer", DataType="fixdt(0,16,0.1,0)", Min=0, Max=511, Unit="km/hr")  % Threshold hystresis speed to activate CL in case of turn indicator is on
C_CL_Ti_Speed_Threshold = Simulink.Parameter(40, StorageClass="ImportedExternPointer", DataType="fixdt(0,16,0.1,0)", Min=0, Max=511, Unit="km/hr")  % Threshold speed to activate CL in case of turn indicator is on
C_ClLeftSideTable_Alpha1 = Simulink.Parameter([20; 35; 50], StorageClass="ImportedExternPointer", DataType="fixdt(1,16,0.1,0)", Min=0, Max=127, Unit="degree", Dimensions="[C_ClTableSize,1]")
C_ClLeftSideTable_Alpha2 = Simulink.Parameter([15; 20; 25], StorageClass="ImportedExternPointer", DataType="fixdt(1,16,0.1,0)", Min=0, Max=127, Unit="degree", Dimensions="[C_ClTableSize,1]")
C_ClRightSideTable_Alpha1 = Simulink.Parameter([20; 35; 50], StorageClass="ImportedExternPointer", DataType="fixdt(1,16,0.1,0)", Min=0, Max=127, Unit="degree", Dimensions="[C_ClTableSize,1]")
C_ClRightSideTable_Alpha2 = Simulink.Parameter([15; 20; 25], StorageClass="ImportedExternPointer", DataType="fixdt(1,16,0.1,0)", Min=0, Max=127, Unit="degree", Dimensions="[C_ClTableSize,1]")
C_ClSpeedCurve = Simulink.Parameter([0; 40; 70], StorageClass="ImportedExternPointer", DataType="fixdt(0,16,0.1,0)", Min=0, Max=511, Unit="km/hr", Dimensions="[C_ClTableSize,1]")
C_ClTableSize = Simulink.Parameter(3, StorageClass="ImportedDefine", DataType="int32", Min=1, Max=25, Unit="one")  % Num of Threshold in curve between speed and curve radius for SBL

C_Cuvre_StWhAngPriority = Simulink.Parameter(1, StorageClass="ImportedExternPointer", DataType="boolean", Min=0, Max=1, Unit="one")  % This parameter defines the priority between SBL & FBL
  % 0: means Activation by StWhAng is On
  % 1: means Activation by CurveRadius is On

C_TiActiveCycle = Simulink.Parameter(25, StorageClass="ImportedExternPointer", DataType="uint8", Min=1, Max=255, Unit="one")  % Number of ticks for Ti activation
N_ClOff = Simulink.Parameter(0, StorageClass="Define", DataType="boolean", Min=0, Max=1, Unit="one")  % Cornering light is Off
N_ClOn = Simulink.Parameter(1, StorageClass="Define", DataType="boolean", Min=0, Max=1, Unit="one")  % Cornering light is On
V_ClEnable = Simulink.Signal(StorageClass="GetSet", GetFunction="get_$N", SetFunction="set_$N", DataType="boolean", Min=0, Max=1, Unit="one")  % This signal used for enable the Cornerning light
V_ClLeft = Simulink.Signal(StorageClass="GetSet", HeaderFile="CL_Master_wrapper.h", GetFunction="get_$N", SetFunction="set_$N", DataType="boolean", Min=0, Max=1, Unit="one")  % Left Corner light state
V_ClRight = Simulink.Signal(StorageClass="GetSet", HeaderFile="CL_Master_wrapper.h", GetFunction="get_$N", SetFunction="set_$N", DataType="boolean", Min=0, Max=1, Unit="one")  % Right Corner light state
V_CurveRadius = Simulink.Signal(StorageClass="GetSet", HeaderFile="CL_Master_wrapper.h", GetFunction="get_$N", SetFunction="set_$N", DataType="fixdt(1,16,0.1,0)", Min=-500, Max=500, Unit="m")  % V_CurveRadius
V_FiltStWhAngleScaled = Simulink.Signal(StorageClass="GetSet", HeaderFile="CL_Master_wrapper.h", GetFunction="get_$N", SetFunction="set_$N", DataType="fixdt(1,16,0.1,0)", Min=-500, Max=500, Unit="degree")  % Filteration steer whhel angle scale
V_FiltVehSpeed = Simulink.Signal(StorageClass="GetSet", HeaderFile="CL_Master_wrapper.h", GetFunction="get_$N", SetFunction="set_$N", DataType="fixdt(0,16,0.1,0)", Min=0, Max=511, Unit="km/hr")  % V_FiltVehSpeed
V_TiLeft = Simulink.Signal(StorageClass="GetSet", HeaderFile="CL_Master_wrapper.h", GetFunction="get_$N", SetFunction="set_$N", DataType="boolean", Min=0, Max=1, Unit="one")  % turn indicator status of left side
V_TiRight = Simulink.Signal(StorageClass="GetSet", HeaderFile="CL_Master_wrapper.h", GetFunction="get_$N", SetFunction="set_$N", DataType="boolean", Min=0, Max=1, Unit="one")  % turn indicator status of right side