% Simulink data dictionary DBL_Master_DD.sldd

C_DblInterDblAngValues = Simulink.Parameter([0 1.8 3.2 5.5 10.2 12 13.4 14.4 15], StorageClass="ImportedExternPointer", DataType="fixdt(0,16,0.1,0)", Min=0, Max=100, Unit="deg", Dimensions="[1,9]")  % C_DblInterDblAngValues
C_DblInterStwAngValues = Simulink.Parameter([0 15 24 34 51 58 65 73 90], StorageClass="ImportedExternPointer", DataType="fixdt(0,16,0.1,0)", Min=0, Max=100, Unit="deg", Dimensions="[1,9]")  % C_DblInterStwAngValues
C_DblRateLimit = Simulink.Parameter(5, StorageClass="ImportedDefine", HeaderFile="DBLM_wrapper.h", DataType="fixdt(0,8,0.1,0)", Min=0, Max=15, Unit="deg")  % C_DblRateLimit
V_FiltStWhAngleScaled = Simulink.Signal(StorageClass="GetSet", HeaderFile="DBLM_wrapper.h", GetFunction="get_$N", SetFunction="set_$N", DataType="fixdt(1,16,0.1,0)", Min=-100, Max=100, Unit="deg")  % V_FiltStWhAngleScaled
VLS_Standard_Configuration = Simulink.ConfigSet(StartTime="0", StopTime="10", FixedStep="0.02", Solver="FixedStepDiscrete", ProdHWDeviceType="NXP->Cortex-M0/M0+", SystemTargetFile="ert.tlc", TargetLang="C")  % AutoGeneratedSLSFconfig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
C_DblSpeed0 = Simulink.Parameter(15, StorageClass="ImportedDefine", HeaderFile="DBLM_wrapper.h", DataType="fixdt(0,16,0.1,0)", Min=0, Max=500, Unit="deg")  % C_DblSpeed0
C_LeftDblMinAngle = Simulink.Parameter(-15, StorageClass="ImportedDefine", HeaderFile="DBLM_wrapper.h", DataType="fixdt(1,16,0.1,0)", Min=-25, Max=25, Unit="deg")  % C_LeftDblMinAngle
C_CSpeed0 = Simulink.Parameter(35, StorageClass="ImportedDefine", HeaderFile="DBLM_wrapper.h", DataType="fixdt(0,16,0.1,0)", Min=0, Max=500, Unit="deg")  % C_CSpeed0
C_DblDeadZone = Simulink.Parameter(5, StorageClass="ImportedDefine", HeaderFile="DBLM_wrapper.h", DataType="fixdt(0,16,0.1,0)", Min=0, Max=90, Unit="deg")  % C_DblDeadZone
V_DblEnable = Simulink.Signal(StorageClass="GetSet", HeaderFile="DBLM_wrapper.h", GetFunction="get_$N", SetFunction="set_$N", DataType="boolean", Min=0, Max=1, Unit="1")  % V_DblEnable
V_FiltVehSpeed = Simulink.Signal(StorageClass="GetSet", HeaderFile="DBLM_wrapper.h", GetFunction="get_$N", SetFunction="set_$N", DataType="fixdt(0,16,0.1,0)", Min=0, Max=500, Unit="deg")  % V_FiltVehSpeed
V_LeftDblAimingAngle = Simulink.Signal(StorageClass="GetSet", HeaderFile="DBLM_wrapper.h", GetFunction="get_$N", SetFunction="set_$N", DataType="fixdt(1,16,0.1,0)", Min=-15, Max=15, Unit="deg")  % V_LeftDblAimingAngle
V_RightDblAimingAngle = Simulink.Signal(StorageClass="GetSet", HeaderFile="DBLM_wrapper.h", GetFunction="get_$N", SetFunction="set_$N", DataType="fixdt(1,16,0.1,0)", Min=-15, Max=15, Unit="deg")  % V_RightDblAimingAngle
C_LeftDblMaxAngle = Simulink.Parameter(2.5, StorageClass="ImportedDefine", HeaderFile="DBLM_wrapper.h", DataType="fixdt(1,16,0.1,0)", Min=-25, Max=25, Unit="deg")  % C_LeftDblMaxAngle
C_RightDblMaxAngle = Simulink.Parameter(15, StorageClass="ImportedDefine", HeaderFile="DBLM_wrapper.h", DataType="fixdt(1,16,0.1,0)", Min=-25, Max=25, Unit="deg")  % C_RightDblMaxAngle
C_RightDblMinAngle = Simulink.Parameter(-2.5, StorageClass="ImportedDefine", HeaderFile="DBLM_wrapper.h", DataType="fixdt(1,16,0.1,0)", Min=-25, Max=25, Unit="deg")  % C_RightDblMinAngle