% Simulink data dictionary LdAfsDblSlaveDD.sldd

C_LedRightLimits = Simulink.Parameter([-3 -2 -1 0 1 2 3 4 5 6 7 -1 0 1 2 3 4 5], StorageClass="ImportedExternPointer", DataType="fixdt(1,16,0.1,0)", Unit="deg", Dimensions="[1,C_NumOfLightingLeds]")
C_LedLeftLimits = Simulink.Parameter([-7 -6 -5 -4 -3 -2 -1 0 1 2 3 -5 -4 -3 -2 -1 0 1], StorageClass="ImportedExternPointer", DataType="fixdt(1,16,0.1,0)", Unit="deg", Dimensions="[1,C_NumOfLightingLeds]")
C_EndIndexOfEachLightingModule = Simulink.Parameter([10 17], StorageClass="ImportedExternPointer", DataType="uint8", Min=0, Max=255, Unit="one", Dimensions="[1,C_NumOfLightingModules]")
C_StartIndexOfEachLightingModule = Simulink.Parameter([0 11], StorageClass="ImportedExternPointer", DataType="uint8", Min=0, Max=255, Unit="one", Dimensions="[1,C_NumOfLightingModules]")
C_DblLeftAngles = Simulink.Parameter([-4 -10; -5 -11], StorageClass="ImportedExternPointer", DataType="fixdt(1,16,0.1,0)", Unit="deg", Dimensions="[C_NumOfLightingModules,C_NumOfLightingModes]")
C_DblRightAngles = Simulink.Parameter([4 10; 5 11], StorageClass="ImportedExternPointer", DataType="fixdt(1,16,0.1,0)", Unit="deg", Dimensions="[C_NumOfLightingModules,C_NumOfLightingModes]")

C_LedCenterDist = Simulink.Parameter([10 20 30 40 50 100 50 40 30 20 10 40 50 60 70 60 50 40
 20 30 40 50 60 70 60 50 40 30 20 50 60 70 100 70 60 50], StorageClass="ImportedExternPointer", DataType="fixdt(0,16,0.01,0)", Min=0, Max=100, Unit="%", Dimensions="[C_NumOfLightingModes,C_NumOfLightingLeds]")

C_LedRightDist = Simulink.Parameter([20 30 40 50 60 70 60 50 40 30 20 50 60 70 80 70 60 50
 30 40 50 60 70 80 70 60 50 40 30 60 70 80 90 80 70 60], StorageClass="ImportedExternPointer", DataType="fixdt(0,16,0.01,0)", Min=0, Max=100, Unit="%", Dimensions="[C_NumOfLightingModes,C_NumOfLightingLeds]")

C_LedLeftDist = Simulink.Parameter([20 30 40 50 60 70 60 50 40 30 20 50 60 70 80 70 60 50
 30 40 50 60 70 80 70 60 50 40 30 60 70 80 90 80 70 60], StorageClass="ImportedExternPointer", DataType="fixdt(0,16,0.01,0)", Min=0, Max=100, Unit="%", Dimensions="[C_NumOfLightingModes,C_NumOfLightingLeds]")

C_CieCurvePwmToGammaY = Simulink.Parameter([0; 4.52; 8.99; 12.61; 15.49; 17.92; 20.04; 21.94; 23.67; 25.26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 100], StorageClass="ImportedExternPointer", DataType="fixdt(0,16,0.01,0)", Unit="%")  % CIE curve PWM to Gamma conversion table
C_CieCurveGammaToPwmY = Simulink.Parameter([0; 0.06; 0.11; 0.17; 0.22; 0.28; 0.33; 0.39; 0.44; 0.5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 100], StorageClass="ImportedExternPointer", DataType="fixdt(0,16,0.01,0)", Unit="%")  % CIE curve Gamma to PWM conversion table
C_DblRampTime = Simulink.Parameter([1 2; 3 4], StorageClass="ImportedExternPointer", DataType="fixdt(0,16,0.005,0)", Min=0, Max=1, Unit="s", Dimensions="[C_NumOfLightingModules,C_NumOfLightingModes]")
C_LedCenterLimits = Simulink.Parameter([-5 -4 -3 -2 -1 0 1 2 3 4 5 -3 -2 -1 0 1 2 3], StorageClass="ImportedExternPointer", DataType="fixdt(1,16,0.1,0)", Unit="deg", Dimensions="[1,C_NumOfLightingLeds]")
C_AfsRampTimeMatrix = Simulink.Parameter([0 1 2; 1 2 3; 4 5 6], StorageClass="ImportedExternPointer", DataType="fixdt(0,16,0.005,0)", Min=0, Max=10, Unit="s", Dimensions="[C_NumOfLightingModes + 1,C_NumOfLightingModes + 1]")
C_IsDblActive = Simulink.Parameter([1 1; 1 0], StorageClass="ImportedExternPointer", DataType="boolean", Unit="one", Dimensions="[C_NumOfLightingModules,C_NumOfLightingModes]")
V_LedPwm = Simulink.Signal(StorageClass="GetSet", HeaderFile="AFSDBLS_wrapper.h", GetFunction="get_$N", SetFunction="set_$N", DataType="fixdt(0,16,0.01,0)", Min=0, Max=100, Unit="%", Dimensions="C_NumOfLightingLeds")
V_DblAngle = Simulink.Signal(StorageClass="GetSet", HeaderFile="AFSDBLS_wrapper.h", GetFunction="get_$N", SetFunction="set_$N", DataType="fixdt(1,16,0.1,0)", Min=-15, Max=15, Unit="deg")
V_ActiveLightingModes = Simulink.Signal(StorageClass="GetSet", HeaderFile="AFSDBLS_wrapper.h", GetFunction="get_$N", SetFunction="set_$N", DataType="uint8", Min=0, Max=12, Unit="one", Dimensions="[C_NumOfLightingModules,1]")
C_DblSlavePeriod = Simulink.Parameter(0.02, StorageClass="ImportedDefine", HeaderFile="AFSDBLS_wrapper.h", DataType="fixdt(0,8,0.005,0)", Min=0.005, Max=1.275, Unit="s")
C_NumOfLightingModules = Simulink.Parameter(2, StorageClass="ImportedDefine", HeaderFile="AFSDBLS_wrapper.h", DataType="int32", Min=0, Max=20, Unit="one")
C_NumOfLightingModes = Simulink.Parameter(2, StorageClass="ImportedDefine", HeaderFile="AFSDBLS_wrapper.h", DataType="int32", Min=0, Max=12, Unit="one")
C_NumOfLightingLeds = Simulink.Parameter(18, StorageClass="ImportedDefine", HeaderFile="AFSDBLS_wrapper.h", DataType="int32", Min=0, Max=255, Unit="one")
VLS_Standard_Configuration = Simulink.ConfigSet(StartTime="0", StopTime="10", FixedStep="0.02", Solver="FixedStepDiscrete", ProdHWDeviceType="NXP->Cortex-M0/M0+", SystemTargetFile="ert.tlc", TargetLang="C")  % AutoGeneratedSLSFconfig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