% Simulink data dictionary Signaling_Sldd.sldd

C_TickTIBlk = Simulink.Parameter(2, StorageClass="ImportedExternPointer", DataType="uint8", Min=1, Max=100, Unit="one")  % is used for timeout to indicate whether TI cycle expire or not
V_DRL_OUT = Simulink.Signal(StorageClass="GetSet", HeaderFile="Signal_wrapper.h", GetFunction="get_$N", SetFunction="set_$N", DataType="boolean", Min=0, Max=1, Unit="one")  % Daytime running light output
V_DRL_Rqst = Simulink.Signal(StorageClass="GetSet", HeaderFile="Signal_wrapper.h", GetFunction="get_$N", SetFunction="set_$N", DataType="boolean", Min=0, Max=1, Unit="one")  % Day time running light request
V_PL_OUT = Simulink.Signal(StorageClass="GetSet", HeaderFile="Signal_wrapper.h", GetFunction="get_$N", SetFunction="set_$N", DataType="boolean", Min=0, Max=1, Unit="one")  % Parking light output
V_PL_Rqst = Simulink.Signal(StorageClass="GetSet", HeaderFile="Signal_wrapper.h", GetFunction="get_$N", SetFunction="set_$N", DataType="boolean", Min=0, Max=1, Unit="one")  % Parking light request
V_TI_Rqst = Simulink.Signal(StorageClass="GetSet", HeaderFile="Signal_wrapper.h", GetFunction="get_$N", SetFunction="set_$N", DataType="boolean", Min=0, Max=1, Unit="one")  % Turn indicator request
V_TiBlink = Simulink.Signal(StorageClass="GetSet", HeaderFile="Signal_wrapper.h", GetFunction="get_$N", SetFunction="set_$N", DataType="boolean", Min=0, Max=1, Unit="one")  % Turn indicator blink
CONFIG_2 = Simulink.Variant(Condition="C_Config == 2")
CONFIG_3 = Simulink.Variant(Condition="C_Config == 3")
CONFIG_4 = Simulink.Variant(Condition="C_Config == 4")
CONFIG_DEFAULT = Simulink.Variant(Condition="C_Config == 0")
C_DrlRampTime = Simulink.Parameter(0, StorageClass="ImportedExternPointer", DataType="fixdt(0,16,0.005,0)", Min=0, Max=5.1, Unit="s")  % Ramp up time to turn on DRL
C_PlNominalPwm = Simulink.Parameter(10, StorageClass="ImportedExternPointer", DataType="fixdt(0,16,0.01,0)", Min=0, Max=100, Unit="%")  % Output PWM when PL is activated
N_MaxPwm = Simulink.Parameter(100, StorageClass="Const", DataType="fixdt(0,16,0.01,0)", Min=0, Max=255, Unit="one")  % Auxilary power supply value
C_TeAdbSlave = Simulink.Parameter(0.02, StorageClass="ImportedExternPointer", DataType="fixdt(0,8,0.005,0)", Min=0, Max=1.275, Unit="s")  % Sample time for low beam ramping
C_CieCurvePwmToGammaY = Simulink.Parameter([0; 4.52; 8.99; 12.61; 15.49; 17.92; 20.04; 21.94; 23.67; 25.26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 100], StorageClass="ImportedExternPointer", DataType="fixdt(0,16,0.01,0)", Min=0, Max=100, Unit="%", Dimensions="[201,1]")  % Y points of the CIE curve that converts from Gamma To Pwm with Gamma [0:0.5:100].
C_CieCurveGammaToPwmY = Simulink.Parameter([0; 0.06; 0.11; 0.17; 0.22; 0.28; 0.33; 0.39; 0.44; 0.5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 100], StorageClass="ImportedExternPointer", DataType="fixdt(0,16,0.01,0)", Min=0, Max=100, Unit="%", Dimensions="[201,1]")  % Y points of the CIE curve that converts from Pwm To Gamma with Pwm [0:0.5:100].
C_IsDrlAutorizedInPower2 = Simulink.Parameter(0, StorageClass="ImportedExternPointer", DataType="boolean", Min=0, Max=1, Unit="one")  % If 0 then DRL is not authorized to work on auxilary supply 2
C_IsPlAutorizedInPower2 = Simulink.Parameter(0, StorageClass="ImportedExternPointer", DataType="boolean", Min=0, Max=1, Unit="one")  % If 0 then PL is not authorized to work on auxilary supply 2
C_IsTiAutorizedInPower2 = Simulink.Parameter(0, StorageClass="ImportedExternPointer", DataType="boolean", Min=0, Max=1, Unit="one")  % If 0 then TI is not authorized to work on auxilary supply 2
N_NumberOfLeds = Simulink.Parameter(10, StorageClass="Const", DataType="uint8", Min=0, Max=255)
C_F_FadingDisableSlidingTI = Simulink.Parameter(0, StorageClass="ImportedExternPointer", DataType="uint8")  % parameter that disables the ramp up on Sliding TI LEDs
C_TiSampleTime = Simulink.Parameter(0.02, StorageClass="ImportedExternPointer", DataType="fixdt(0,8,0.01,0)")
C_F_RampTimeSlidingTI = Simulink.Parameter(0.1, StorageClass="ImportedExternPointer", DataType="fixdt(0,8,0.01,0)", Unit="one")  % ramp time when turning ON a Sliding TI LED
C_B_SlidingTiStepOfTheLeds = Simulink.Parameter([2 5 8 12 15], StorageClass="ImportedExternPointer", DataType="uint8", Min=0, Max=255, Dimensions="[1,N_NumberOfTiLeds]")  % parameters that give the step of the counter value from which each LED shall be turned ON. If a LED is a simple TI (not a sliding one), the value of this parameter will be 0 for this LED.
C_TiLEDsOff = Simulink.Parameter(repmat(0, 1, 5), StorageClass="ImportedExternPointer", DataType="fixdt(0,16,0.01,0)", Dimensions="[1,N_NumberOfTiLeds]")
C_DefaultTiLEDsPwm = Simulink.Parameter(repmat(100, 1, 5), StorageClass="ImportedExternPointer", DataType="fixdt(0,16,0.01,0)", Dimensions="[1,N_NumberOfTiLeds]")
V_SideMarker = Simulink.Signal(StorageClass="GetSet", HeaderFile="Signal_wrapper.h", GetFunction="get_$N", SetFunction="set_$N", DataType="uint8", Min=0, Max=255)

V_ActivePowerSupply = Simulink.Signal(StorageClass="GetSet", HeaderFile="Signal_wrapper.h", GetFunction="get_$N", SetFunction="set_$N", DataType="boolean", Min=0, Max=1, Unit="one")  % This to define which power supply is used:
  % 0: Main power supply
  % 1: Aux power supply

V_TiCycle = Simulink.Signal(StorageClass="GetSet", HeaderFile="Signal_wrapper.h", GetFunction="get_$N", SetFunction="set_$N", DataType="uint8", Min=0, Max=255, Unit="one")  % Status to tell that the TI is in off cycle and not switched off
N_NumberOfTiLeds = Simulink.Parameter(5, StorageClass="ImportedDefine", HeaderFile="Signal_wrapper.h", DataType="int32")
V_DrlPlFunctionTpsPwm = Simulink.Signal(StorageClass="GetSet", HeaderFile="Signal_wrapper.h", GetFunction="get_$N", SetFunction="set_$N", DataType="fixdt(0,16,0.01,0)", Min=0, Max=100)  % Daylight running output PWM
V_TiFunctionTpsPwm = Simulink.Signal(StorageClass="GetSet", HeaderFile="Signal_wrapper.h", GetFunction="get_$N", SetFunction="set_$N", DataType="fixdt(0,16,0.01,0)", Min=0, Max=100, Dimensions="N_NumberOfTiLeds")  % turn indicator PWM
C_PlOverDRL = Simulink.Parameter(1, StorageClass="ImportedExternPointer", DataType="uint8", Min=0, Max=5, Unit="one")  % Indicates the priority between PL and DRL
V_TI_OUT = Simulink.Signal(StorageClass="GetSet", HeaderFile="Signal_wrapper.h", GetFunction="get_$N", SetFunction="set_$N", DataType="boolean", Min=0, Max=1, Unit="one")  % Turn indicator output
CONFIG_1 = Simulink.Variant(Condition="C_Config == 1")
C_Config = Simulink.Parameter(1, StorageClass="ImportedDefine", HeaderFile="Signal_wrapper.h", DataType="uint8", Min=0, Max=5, Unit="one")  % Determine the mode of signaling.
VLS_Standard_RH850_Signalling = Simulink.ConfigSet(StartTime="0", StopTime="10", FixedStep="0.02", Solver="FixedStepDiscrete", ProdHWDeviceType="Renesas->RH850", SystemTargetFile="ert.tlc", TargetLang="C")  % VLS Standard Config for RH850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