% Simulink data dictionary Ramp_Lib.sldd

SampleTime = Simulink.Parameter(0.02, DataType="uint8", Unit="s")  % Periodic/Sample time
C_CieCurvePwmToGammaY = Simulink.Parameter([0; 4.52; 8.99; 12.61; 15.49; 17.92; 20.04; 21.94; 23.67; 25.26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 100], DataType="fixdt(0,16,0.01,0)", Unit="%")  % CIE curve PWM to Gamma conversion table
C_CieCurveGammaToPwmY = Simulink.Parameter([0; 0.06; 0.11; 0.17; 0.22; 0.28; 0.33; 0.39; 0.44; 0.5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 100], DataType="fixdt(0,16,0.01,0)", Unit="%")  % CIE curve Gamma to PWM conversion table